# Grasshopper definition 220308_6FMA.gh (Grasshopper 1.0.7)
# plug-ins: Pufferfish, Wallacei, LunchBox, Wombat

image_resource = ImageResource("C:\Users\Miguel\University of Hertfordshire\Silvio Carta - 6FMA\GH\Housing_Density.JPG")
image_resource_2 = ImageResource("C:\Users\Miguel\University of Hertfordshire\Silvio Carta - 6FMA\GH\processed-57ef5931-57d7-41b4-adbb-dc022093c669_NzXJcnnl.jpeg")
image_resource_3 = ImageResource("C:\Users\Miguel\University of Hertfordshire\Silvio Carta - 6FMA\GH\London_Housing.JPG")

# ----
# Distance Between Buildings
number_slider = Slider(30, range=16..50)
distance_between_buildings = Integer(number_slider)

# ----
# Assumptions
panel = Panel("7.25")
common_areas_corridor_width = Number("1.5")
max_balconies_depth = Number("1.55")
floor_to_floor_height = Number("3.5")
_2_bed_sqm = Number("70")
# Variables
_1_bed_sqm = Number("52")
unit_structural = Number(panel)
_3_bed_sqm = Number("86")

panel_2 = Panel("Try to test")

# ----
# Shared indoor area per resident
number_slider_2 = Slider(0, range=0..39)
shared_indoor_area_per_resident = Number(number_slider_2)

image_resource_4 = ImageResource("C:\Users\Miguel\University of Hertfordshire\Silvio Carta - 6FMA\GH\Weighting.jpeg")

# ----
# Shared indoor area
# per resident (0- 39 sqm)
shared_indoor_area_per_resident_2 = Number(shared_indoor_area_per_resident)
dom = ConstructDomain(DomainStart="0", DomainEnd="39")
remap = RemapNumbers(Value=shared_indoor_area_per_resident_2, Source=dom, Target=Domain(0, 1))  # -> Mapped, Clipped
shared_indoor_area_per_resident_normaliz = Number(remap.Mapped)  # "Shared indoor area per resident - NORMALIZED"

panel_3 = Panel("C:\Users\Miguel\University of Hertfordshire\Silvio Carta - 6FMA\GH\")
folder_path = FilePath(panel_3)

txt = Text("QUALITY VALUES")
txt_2 = Text("GENE POOL VALUE")
concat = Concatenate(FragmentA="PARAMETER", FragmentB=",", FragmentC=txt, FragmentD=",", FragmentE=txt_2)  # -> flatten(Result)

# ----
# Gene pool
# Area per resident
wlc_area_per_resident = Slider(58, range=39..61)
area_per_resident = Number(wlc_area_per_resident)

# ----
# Area per resident (39 - 61 sqm)
area_per_resident_2 = Number(area_per_resident)
dom_2 = ConstructDomain(DomainStart="39", DomainEnd="61")
remap_2 = RemapNumbers(Value=area_per_resident_2, Source=dom_2, Target=Domain(0, 1))  # -> Mapped, Clipped
area_per_resident_normalized = Number(remap_2.Clipped)

# ----
# Maximise
# Area per resident
area_per_resident_normalized_2 = Number(area_per_resident_normalized)
cost_sqm_weighting_f = Number("1.2")
# Criteria Weighting
multiplication = Multiplication(A=area_per_resident_normalized_2, B=cost_sqm_weighting_f)
area_per_resident_weighted = Number(multiplication)

area_per_resident_weighted_2 = Number(area_per_resident_weighted)
area_per_resident_weighted_3 = Number(area_per_resident_weighted)

area_per_resident_quality = Number(area_per_resident_weighted_3)
area_per_resident_3 = Number(area_per_resident)
txt_3 = Text("Area per resident")
concat_2 = Concatenate(FragmentA=txt_3, FragmentB=",", FragmentC=area_per_resident_quality, FragmentD=",", FragmentE=area_per_resident_3)  # -> flatten(Result)
area_per_resident_text = Text(concat_2)

# ----
# Private outdoor space
number_slider_3 = Slider(10, range=0..10)
balconies_area = Number(number_slider_3)

# ----
# Private outdoor space
# per resident (0 - 10 sqm)
balconies_area_2 = Number(balconies_area)
dom_3 = ConstructDomain(DomainStart="0", DomainEnd="39")
remap_3 = RemapNumbers(Value=balconies_area_2, Source=dom_3, Target=Domain(0, 1))  # -> Mapped, Clipped
private_outdoor_space_normalized = Number(remap_3.Clipped)

# ----
# Private outdoor space
panel_4 = Panel("1.2")
private_outdoor_space_normalized_2 = Number(private_outdoor_space_normalized)
private_outdoor_space_weighting_f = Number(panel_4)
multiplication_2 = Multiplication(A=private_outdoor_space_normalized_2, B=private_outdoor_space_weighting_f)
private_outdoor_space_weighted = Number(multiplication_2)

private_outdoor_space_weighted_2 = Number(private_outdoor_space_weighted)
private_outdoor_space_weighted_3 = Number(private_outdoor_space_weighted)

private_outdoor_space_quality = Number(private_outdoor_space_weighted_3)
balconies_area_3 = Number(balconies_area)
txt_4 = Text("Private outdoor space")
concat_3 = Concatenate(FragmentA=txt_4, FragmentB=",", FragmentC=private_outdoor_space_quality, FragmentD=",", FragmentE=balconies_area_3)  # -> flatten(Result)
private_outdoor_space_text = Text(concat_3)

# ----
# Density
density = Slider(85, range=35..400)
density_units_ha = Number(density)

# ----
# Plot area (Shared Outdoor Space)
wlc_plot_area = Slider(8307, range=5000..25000)
plot_area_sqm = Integer(wlc_plot_area)

# ----
# Units Density / Population
density_2 = Slider(148, range=35..400)
plot_area_sqm_2 = Integer(plot_area_sqm)
multiplication_3 = Multiplication(A=plot_area_sqm_2, B="0.0001")
plot_area_ha = Number(multiplication_3)
density_units_ha_2 = Number(density_2)
division = Division(A=density_units_ha_2, B=plot_area_ha)
# Variables to be optimised
# Maximise
population = Integer(division)

# ----
# Density (35 - 260 units/Ha)
panel_5 = Panel("35")
density_units_ha_3 = Number(density_units_ha_2)
dom_4 = ConstructDomain(DomainStart=panel_5, DomainEnd="260")
remap_4 = RemapNumbers(Value=density_units_ha_3, Source=dom_4, Target=Domain(0, 1))  # -> Mapped, Clipped
density_units_ha_normalized = Number(remap_4.Clipped)

# ----
# Plot area (5000 - 25000 sqm)
panel_6 = Panel("5000")
plot_area_sqm_3 = Integer(plot_area_sqm)
dom_5 = ConstructDomain(DomainStart=panel_6, DomainEnd="25000")
remap_5 = RemapNumbers(Value=plot_area_sqm_3, Source=dom_5, Target=Domain(0, 1))  # -> Mapped, Clipped
plot_area_normalized = Number(remap_5.Clipped)

population_2 = Integer(population)

# ----
# Density
density_units_ha_normalized_2 = Number(density_units_ha_normalized)

density_units_ha_normalized_3 = Number(density_units_ha_normalized_2)
density_units_ha_normalized_4 = Number(density_units_ha_normalized_2)

density_units_ha_4 = Number(density_units_ha)
density_quality = Number(density_units_ha_normalized_4)
txt_5 = Text("Density")
concat_4 = Concatenate(FragmentA=txt_5, FragmentB=",", FragmentC=density_quality, FragmentD=",", FragmentE=density_units_ha_4)  # -> flatten(Result)
density_text = Text(concat_4)

# ----
# Not related to Q
# (design variables)
links = Slider(3, range=2..10)
number_of_surrounding_links = Integer(links)

# ----
# Cost per sqm
# Number of Surrounding Links
number_slider_4 = Slider(4397, range=3994..19439)
cost_sqm = Number(number_slider_4)

# ----
# Building Floors
# Kill solutions if:
number_slider_5 = Slider(6, range=4..12)
number_of_floors = Integer(number_slider_5)

number_of_floors_2 = Integer(number_of_floors)
txt_6 = Text("Number of Floors")
concat_5 = Concatenate(FragmentA=txt_6, FragmentB=",", FragmentC=" ", FragmentD=",", FragmentE=number_of_floors_2)  # -> flatten(Result)
number_of_floors_text = Text(concat_5)

# ----
# Number of Buildings
number_slider_6 = Slider(4, range=1..6)
number_of_buildings = Integer(number_slider_6)

number_of_buildings_2 = Integer(number_of_buildings)
txt_7 = Text("Number of Buildings")
concat_6 = Concatenate(FragmentA=txt_7, FragmentB=",", FragmentC=" ", FragmentD=",", FragmentE=number_of_buildings_2)  # -> flatten(Result)
number_of_buildings_text = Text(concat_6)

unit_structural_span = Number(unit_structural)
common_areas_corridor_width_2 = Number(common_areas_corridor_width)
multiplication_4 = Multiplication(A=unit_structural_span, B="2")
addition = Addition(A=multiplication_4, B=common_areas_corridor_width_2)
block_width = Number(addition)

# ----
# Shared open spaces
population_3 = Integer(population)

# ----
# Cost
plot_area_sqm_4 = Integer(plot_area_sqm)
cost_per_sqm_land = Number("1000")
cost_sqm_2 = Number(cost_sqm)
multiplication_5 = Multiplication(A=plot_area_sqm_4, B=cost_per_sqm_land)

# ----
# Shared outdoor spaces (30 - 90 sqm/unit)
# link with plot area
panel_7 = Panel("30")
dom_6 = ConstructDomain(DomainStart=panel_7, DomainEnd="90")

dom_7 = ConstructDomain(DomainStart="0", DomainEnd="500")

# ----
# Cost -- link with area
# per resident and building area
panel_8 = Panel("250000")
dom_8 = ConstructDomain(DomainStart=panel_8, DomainEnd="450000")

# ----
# Cost
panel_9 = Panel("2.37")
cost_sqm_weighting_f_2 = Number(panel_9)

# ----
# Distance to urban links
panel_10 = Panel("0.41")
links_weighting_f = Number(panel_10)

number_of_surrounding_links_2 = Integer(number_of_surrounding_links)
txt_8 = Text("Distance to Urban Links")

cost_sqm_3 = Number(cost_sqm)
txt_9 = Text("Cost per sqm")

# ----
# Write Information to txt
panel_11 = Panel("-Multi_Objective")
txt_10 = Text("Quality(")
txt_11 = Text("Q'")
txt_12 = Text(")")
txt_13 = Text("")
concat_7 = Concatenate(FragmentA=txt_10, FragmentD=txt_11, FragmentC=txt_13, FragmentB=txt_12)
panel_12 = Panel(concat_7)
concat_8 = Concatenate(FragmentA=concat_7, FragmentB=panel_11)
file_name = Text(concat_8)
concat_9 = Concatenate(FragmentA=file_name, FragmentD=".csv")
txt_14 = Text("")
concat_10 = Concatenate(FragmentA=folder_path, FragmentB=concat_9)

plot_area_sqm_5 = Integer(plot_area_sqm)
txt_15 = Text("Shared Open Space")

# ----
# Maximise
area_per_resident_normalized_3 = Number(area_per_resident_normalized)
private_outdoor_space_normalized_3 = Number(private_outdoor_space_normalized_2)
density_units_ha_normalized_5 = Number(density_units_ha_normalized_2)
multiplication_6 = Multiplication(A=private_outdoor_space_normalized_3, B="10")

# ----
# Maximise
density_units_ha_normalized_6 = Number(density_units_ha_normalized_2)
area_per_resident_weighted_4 = Number(area_per_resident_weighted)
private_outdoor_space_weighted_4 = Number(private_outdoor_space_weighted)

# ----
# Maximise
area_per_resident_normalized_4 = Number(area_per_resident_normalized)
private_outdoor_space_normalized_4 = Number(private_outdoor_space_normalized)
density_units_ha_normalized_7 = Number(density_units_ha_normalized)

# ----
# Maximise
density_units_ha_normalized_8 = Number(density_units_ha_normalized_2)
private_outdoor_space_normalized_5 = Number(private_outdoor_space_normalized_2)
area_per_resident_normalized_5 = Number(area_per_resident_normalized)
panel_13 = Panel(density_units_ha_normalized_8)

# ----
# Maximise
density_units_ha_normalized_9 = Number(density_units_ha_normalized_2)
private_outdoor_space_normalized_6 = Number(private_outdoor_space_normalized_2)
area_per_resident_normalized_6 = Number(area_per_resident_normalized)
panel_14 = Panel(density_units_ha_normalized_9)

# ----
# Maximise
private_outdoor_space_normalized_7 = Number(private_outdoor_space_normalized_2)
area_per_resident_normalized_7 = Number(area_per_resident_normalized)
density_units_ha_normalized_10 = Number(density_units_ha_normalized_2)

# ----
# Maximise
density_units_ha_normalized_11 = Number(density_units_ha_normalized_2)
private_outdoor_space_normalized_8 = Number(private_outdoor_space_normalized_2)
area_per_resident_normalized_8 = Number(area_per_resident_normalized)
multiplication_7 = Multiplication(A=density_units_ha_normalized_11, B="10")

# ----
# Maximise
density_units_ha_normalized_12 = Number(density_units_ha_normalized_2)
private_outdoor_space_weighted_5 = Number(private_outdoor_space_weighted)
area_per_resident_weighted_5 = Number(area_per_resident_weighted)

# ----
# Maximise
private_outdoor_space_normalized_9 = Number(private_outdoor_space_normalized_2)
density_units_ha_normalized_13 = Number(density_units_ha_normalized_2)

# ----
# Quality (Q1) - Single Objective WITHOUT WEIGHTS: MAXIMISE
# - Area per resident * 10
# - Private Outdoor Space
# - Shared Open Space per resident
# - Density (units/Ha)
# 
# MINIMISE
# - Cost/sqm
# - Distance to Urban Links
# Quality (Q2)
area_per_resident_normalized_9 = Number(area_per_resident_normalized)
panel_15 = Panel(density_units_ha_normalized_13)
multiplication_8 = Multiplication(A=area_per_resident_normalized_9, B="10")
panel_16 = Panel(area_per_resident_normalized_9)
panel_17 = Panel(multiplication_8)
neg = Negative(Value=density_units_ha_normalized_13)
neg_2 = Negative(Value=private_outdoor_space_normalized_9)
neg_3 = Negative(Value=multiplication_8)

# ----
# Quality (Q)
neg_4 = Negative(Value=area_per_resident_weighted_4)
neg_5 = Negative(Value=private_outdoor_space_weighted_4)
neg_6 = Negative(Value=density_units_ha_normalized_6)
panel_18 = Panel(area_per_resident_weighted_4)
quality_q_multi_objective = Panel("""WEIGHTED VALUES - MULTI-OBJECTIVE
MAXIMISE
- Area per resident 
- Private Outdoor Space
-Shared Open Space per resident
- Density (units/Ha)

MINIMISE
- Cost/sqm
- Distance to Urban Links""")
panel_19 = Panel(density_units_ha_normalized_6)
panel_20 = Panel(private_outdoor_space_weighted_4)
quality_q_single_objective = Panel("""WEIGHTED VALUES
MAXIMISE
- Area per resident 
- Private Outdoor Space
-Shared Open Space per resident
- Density (units/Ha)

MINIMISE
- Cost/sqm
- Distance to Urban Links""")
q_explanation = Text(quality_q_multi_objective)
q_explanation_2 = Text(quality_q_single_objective)

q_explanation_3 = Text(q_explanation)
q_explanation_4 = Text(q_explanation_2)

# ----
# Quality (Q3)
panel_21 = Panel(density_units_ha_normalized_5)
panel_22 = Panel(multiplication_6)
quality_q1_single_objective_without_weig = Panel("""NORMALISED VALUES
Maximise
- Area per resident 
- Private Outdoor Space *10
- Shared Open Space per resident
- Density (units/Ha)

Miinimise
- Cost/sqm
- Distance to Urban Links""")  # "Quality (Q1) - Single Objective WITHOUT WEIGHTS"
neg_7 = Negative(Value=area_per_resident_normalized_3)
neg_8 = Negative(Value=multiplication_6)
neg_9 = Negative(Value=density_units_ha_normalized_5)
q3_explanation = Text(quality_q1_single_objective_without_weig)

# ----
# Quality (Q5)
panel_23 = Panel(area_per_resident_normalized_8)
panel_24 = Panel(multiplication_7)
quality_q5_single_objective_without_weig = Panel("""NORMALISED VALUES
Maximise
- Area per resident 
- Private Outdoor Space 
- Shared Open Space per resident 
- Density (units/Ha)*10

Minimise
- Cost/sqm
- Distance to Urban Links""")  # "Quality (Q5) - Single Objective WITHOUT WEIGHTS"
neg_10 = Negative(Value=area_per_resident_normalized_8)
neg_11 = Negative(Value=multiplication_7)
neg_12 = Negative(Value=private_outdoor_space_normalized_8)
q5_explanation = Text(quality_q5_single_objective_without_weig)

# ----
# Quality (Q4)
panel_25 = Panel(area_per_resident_normalized_7)
panel_26 = Panel(density_units_ha_normalized_10)
quality_q1_single_objective_without_weig_2 = Panel("""NORMALISED VALUES
Maximise
- Area per resident 
- Private Outdoor Space 
- Shared Open Space per resident *10
- Density (units/Ha)

Miinimise
- Cost/sqm
- Distance to Urban Links""")  # "Quality (Q1) - Single Objective WITHOUT WEIGHTS"
neg_13 = Negative(Value=area_per_resident_normalized_7)
neg_14 = Negative(Value=density_units_ha_normalized_10)
neg_15 = Negative(Value=private_outdoor_space_normalized_7)
q4_explanation = Text(quality_q1_single_objective_without_weig_2)

# ----
# Quality (Q1)
# Normalized Values
panel_27 = Panel(private_outdoor_space_normalized_4)
panel_28 = Panel(density_units_ha_normalized_7)
panel_29 = Panel(area_per_resident_normalized_4)
neg_16 = Negative(Value=area_per_resident_normalized_4)
neg_17 = Negative(Value=private_outdoor_space_normalized_4)
neg_18 = Negative(Value=density_units_ha_normalized_7)
quality_q1_single_objective_without_weig_3 = Panel("""NORMALISED VALUES
Maximise
- Area per resident
- Private Outdoor Space
- Shared Open Space per resident
- Density (units/Ha)

Minimise
- Cost/sqm
- Distance to Urban Links""")  # "Quality (Q1) - Single Objective WITHOUT WEIGHTS"
quality_q1_explanation = Text(quality_q1_single_objective_without_weig_3)

# ----
# Quality
panel_30 = Panel(density_units_ha_normalized_12)
panel_31 = Panel(private_outdoor_space_weighted_5)

# ----
# Quality (Q6)
neg_19 = Negative(Value=density_units_ha_normalized_8)
quality_q5_single_objective_without_weig_2 = Panel("""NORMALISED VALUES
Maximise
- Area per resident 
- Private Outdoor Space 
- Shared Open Space per resident 
- Density (units/Ha)

Minimise
- Cost/sqm *10
- Distance to Urban Links""")  # "Quality (Q5) - Single Objective WITHOUT WEIGHTS"
neg_20 = Negative(Value=private_outdoor_space_normalized_5)
neg_21 = Negative(Value=area_per_resident_normalized_5)
q6_explanation = Text(quality_q5_single_objective_without_weig_2)

# ----
# Quality (Q7)
neg_22 = Negative(Value=density_units_ha_normalized_9)
quality_q5_single_objective_without_weig_3 = Panel("""NORMALISED VALUES
Maximise
- Area per resident 
- Private Outdoor Space 
- Shared Open Space per resident 
- Density (units/Ha)

Minimise
- Cost/sqm 
- Distance to Urban Links *10""")  # "Quality (Q5) - Single Objective WITHOUT WEIGHTS"
neg_23 = Negative(Value=private_outdoor_space_normalized_6)
neg_24 = Negative(Value=area_per_resident_normalized_6)
q7_explanation = Text(quality_q5_single_objective_without_weig_3)

# ----
# Bake
toggle = BooleanToggle(False)

# ----
# Units per floor are less than 2
panel_32 = Panel("2")

# ----
# Units per floor are more than 8
panel_33 = Panel("8")

# ----
# Building plans intersect
panel_34 = Panel("1")

# ----
# Units
# {A;B;C} (i)
# {Building; Column; Unit/Corridor/Unit} (Floors)
# Units
# Corridor
common_areas_corridor_width_3 = Number(common_areas_corridor_width)
unit_structural_span_2 = Number(unit_structural)
block_width_2 = Number(block_width)
division_2 = Division(A=unit_structural_span_2, B=block_width_2)
division_3 = Division(A=common_areas_corridor_width_3, B=block_width_2)
unit_normalized_depth = Number(division_2)
corridor_normalized_depth = Number(division_3)
addition_2 = Addition(A=unit_normalized_depth, B=corridor_normalized_depth)
addition_3 = Addition(A=addition_2, B=unit_normalized_depth)
merge = Merge(Data1="0", Data2=flatten(unit_normalized_depth), Data3=flatten(addition_2), Data4=flatten(addition_3))
floor_to_floor_height_2 = Number(floor_to_floor_height)
number_of_floors_3 = Integer(number_of_floors)
series = Series(Start=0, Step=floor_to_floor_height_2, Count=number_of_floors_3)
Z = UnitZ(Factor=series)
floor_to_floor_height_3 = Number(floor_to_floor_height)
Z_2 = UnitZ(Factor=floor_to_floor_height_3)

# ----
# Buildings
area_per_resident_4 = Number(area_per_resident)
unit_structural_span_3 = Number(unit_structural)
division_4 = Division(A=area_per_resident_4, B=unit_structural_span_3)
floor_to_floor_height_4 = Number(floor_to_floor_height)
number_of_floors_4 = Integer(number_of_floors)
multiplication_9 = Multiplication(A=floor_to_floor_height_4, B=number_of_floors_4)
block_width_3 = Number(block_width)
building_height = Number(multiplication_9)
dom_9 = ConstructDomain(DomainStart=expr("-x/2", block_width_3), DomainEnd=expr("x/2", block_width_3))
domainz = Domain(building_height)
domainy = Domain(dom_9)

# ----
# Links to other urban services
plot_area_sqm_6 = Integer(plot_area_sqm)
sqrt = SquareRoot(Value=plot_area_sqm_6)
number_of_surrounding_links_3 = Integer(number_of_surrounding_links)
square_size = Number(sqrt)
population_4 = Number(population)
dom_10 = ConstructDomain(DomainStart="0", DomainEnd="360")
sqr = Square(Value=square_size)
multiplication_10 = Multiplication(A=number_of_surrounding_links_3, B=population_4)
multiplication_11 = Multiplication(A="2", B=sqr)
sqrt_2 = SquareRoot(Value=multiplication_11)
random = Random(Range=dom_10, Number=number_of_surrounding_links_3, Seed=multiplication_10)
division_5 = Division(A=sqrt_2, B="2")
rad = Radians(Degrees=random)
population_5 = Number(population)
addition_4 = Addition(A=division_5, B="20")
multiplication_12 = Multiplication(A=division_5, B="4")
dom_11 = ConstructDomain(DomainStart=addition_4, DomainEnd=multiplication_12)
addition_5 = Addition(A=number_of_surrounding_links_3, B=population_5)
random_2 = Random(Range=dom_11, Number=number_of_surrounding_links_3, Seed=addition_5)

# ----
# Buildings Location
plot_area = Integer(plot_area_sqm)
number_of_buildings_3 = Integer(number_of_buildings)
# Model
population_6 = Integer(population)
sqrt_3 = SquareRoot(Value=plot_area)
dom_12 = ConstructDomain(DomainStart=expr("-x/2", sqrt_3), DomainEnd=expr("x/2", sqrt_3))
division_6 = Division(A=population_6, B=number_of_buildings_3)
dom_13 = ConstructDomain(DomainStart=expr("-x/2", sqrt_3), DomainEnd=expr("x/2", sqrt_3))
number_of_floors_5 = Integer(number_of_floors)
plot_domainx = Domain(dom_12)
plot_domainy = Domain(dom_13)
units_per_building = Integer(division_6)
rectangle = Rectangle(Plane=PlaneXY(0, 0, 0), XSize=plot_domainx, YSize=plot_domainy, Radius=0)  # -> Rectangle, Length
division_7 = Division(A=units_per_building, B=number_of_floors_5)
plot = Rectangle(rectangle.Rectangle)
division_8 = Division(A=division_7, B="2")
round = Round(Number=division_8)  # -> Nearest, Floor, Ceiling
units_per_floor = Integer(round.Ceiling)
X = UnitX(Factor=1)
number_of_buildings_4 = Integer(number_of_buildings)
distance_between_buildings_2 = Integer(distance_between_buildings)

plot_2 = Rectangle(plot)

units_per_floor_2 = Integer(units_per_floor)
larger = LargerThan(FirstNumber=units_per_floor_2, SecondNumber=panel_32)  # -> LargerThan, OrEqualTo
int = Integer(larger.OrEqualTo)

units_per_floor_3 = Integer(units_per_floor)
smaller = SmallerThan(FirstNumber=units_per_floor_3, SecondNumber=panel_33)  # -> SmallerThan, OrEqualTo
int_2 = Integer(smaller.OrEqualTo)

plot_3 = Rectangle(plot)
area = Area(Geometry=plot_3)  # -> Area, Centroid
pt = PointPolar(BasePlane=area.Centroid, XYAngle=rad, ZAngle=0, Offset=random_2)
urban_services = Point(pt)
preview = CustomPreview(Geometry=urban_services, Material=ColourSwatch(SwatchColor=RGB(236, 46, 255)))

# ----
# Annotations
# Shared Spaces Area
plot_4 = Rectangle(plot)
area_2 = Area(Geometry=plot_4)  # -> Area, Centroid
pdecon = Deconstruct(Point=area_2.Centroid)  # -> XComponent, YComponent, ZComponent
building_height_2 = Number(building_height)
shared_open_spaces_area = Number(area_2.Area)
addition_6 = Addition(A=pdecon.ZComponent, B=building_height_2, C="30")
panel_35 = Panel("""Shared Open Spaces
A = """)
expression = Expression(x=shared_open_spaces_area, Expression="Round(x,2)")
pt_2 = ConstructPoint(XCoordinate=pdecon.XComponent, YCoordinate=pdecon.YComponent, ZCoordinate=addition_6)
Z_3 = UnitZ(Factor=1)
ln = Line(StartPoint=area_2.Centroid, EndPoint=pt_2)
concat_11 = Concatenate(FragmentA=panel_35, FragmentB=expression, FragmentC=" sqm")
pl = ConstructPlane(Origin=pt_2, XAxis=Vector(1, 0, 0), YAxis=Z_3)
txt_16 = Text(concat_11)
text_size = Number("2")
dash = DashPattern(Curve=ln, Pattern="1")  # -> Dashes, Gaps
tag = TextTag3D(Location=pl, Text=txt_16, Size=text_size, Justification=7)

plot_5 = Rectangle(plot)
urban_services_2 = Point(urban_services)
srf = Surface(plot_5)

units_floor = Number(units_per_floor)
multiplication_13 = Multiplication(A=units_floor, B=division_4)
block_length = Number(multiplication_13)
dom_14 = ConstructDomain(DomainStart=expr("-x/2", block_length), DomainEnd=expr("x/2", block_length))
domainx = Domain(dom_14)

block_length_2 = Number(block_length)
division_9 = Division(A=block_length_2, B="3")
offset = OffsetCurve(Curve=plot, Distance=expr("-x", division_9), Plane=PlaneXY(0, 0, 0), Corners=1)
plot_offset_2_in_grid = Curve(offset)
area_3 = Area(Geometry=plot_offset_2_in_grid)  # -> Area, simplify(Centroid)
pl_2 = ConstructPlane(Origin=area_3.Centroid, XAxis=X, YAxis=Vector(0, 1, 0))
bbox = BoundingBox(Content=plot_offset_2_in_grid, Plane=pl_2)  # -> Box, Box_2
rec = Rectangle(bbox.Box)
pop2d = Populate2D(Region=rec, Count=number_of_buildings_4, Seed=1)  # -> simplify(Population)
base_points = Point(pop2d)
voronoi = Voronoi(Points=base_points, Radius=distance_between_buildings_2, Boundary=rec, Plane=pl_2, BruteForceOverride=False)
area_4 = Area(Geometry=voronoi)  # -> Area, simplify(Centroid)
base_points_2 = Point(area_4.Centroid)

base_points_3 = Point(base_points_2)
box = DomainBox(Base=base_points_3, X=domainx, Y=domainy, Z=domainz)
rectangle_2 = Rectangle(Plane=base_points_3, XSize=domainx, YSize=domainy, Radius=0)  # -> Rectangle, Length
buildigns_plan = Rectangle(rectangle_2.Rectangle)
buildings = Box(box)

buildigns_plan_2 = Rectangle(buildigns_plan)
mcx = MultipleCurves(Curves=flatten(buildigns_plan_2))  # -> Points, IndexA, IndexB, ParamA, ParamB
lng = ListLength(List=mcx.Points)
larger_2 = LargerThan(FirstNumber=lng, SecondNumber=panel_34)  # -> LargerThan, OrEqualTo
not = GateNot(A=larger_2.LargerThan)
int_3 = Integer(not)

# ----
# Shared Open Spaces
buildigns_plan_3 = Rectangle(buildigns_plan)
plot_6 = Rectangle(plot)
merge_2 = Merge(Data1=plot_6, Data2=buildigns_plan_3)  # -> flatten(Result)
boundary = BoundarySurfaces(Edges=merge_2)
shared_open_spaces = Brep(boundary)

shared_open_spaces_2 = Brep(shared_open_spaces)
area_5 = Area(Geometry=shared_open_spaces_2)  # -> Area, Centroid
shared_open_space_area = Number(area_5.Area)
division_10 = Division(A=shared_open_space_area, B=population_3)
shared_open_space_per_resident_sqm = Number(division_10)

shared_open_space_per_resident_sqm_2 = Number(shared_open_space_per_resident_sqm)
remap_6 = RemapNumbers(Value=shared_open_space_per_resident_sqm_2, Source=dom_6, Target=Domain(0, 1))  # -> Mapped, Clipped
shared_open_space_per_resident_normalize = Number(remap_6.Clipped)  # "Shared Open Space per resident - NORMALIZED"

# ----
# Shared outdoor spaces
shared_open_space_per_resident_normalize_2 = Number(shared_open_space_per_resident_normalize)  # "Shared Open Space per resident - NORMALIZED"

shared_open_space_per_resident_normalize_3 = Number(shared_open_space_per_resident_normalize_2)  # "Shared Open Space per resident - NORMALIZED"
shared_open_space_per_resident_normalize_4 = Number(shared_open_space_per_resident_normalize_2)  # "Shared Open Space per resident - NORMALIZED"

shared_open_space_per_resident_quality = Number(shared_open_space_per_resident_normalize_4)
concat_12 = Concatenate(
    FragmentA=txt_15,
    FragmentB=",",
    FragmentC=shared_open_space_per_resident_quality,
    FragmentD=",",
    FragmentE=plot_area_sqm_5)  # -> flatten(Result)
shared_open_space_text = Text(concat_12)

shared_open_space_per_resident_normalize_5 = Number(shared_open_space_per_resident_normalize_2)  # "Shared Open Space per resident - NORMALIZED"

shared_open_space_per_resident_normalize_6 = Number(shared_open_space_per_resident_normalize_2)  # "Shared Open Space per resident - NORMALIZED"
multiplication_14 = Multiplication(A=shared_open_space_per_resident_normalize_6, B="10")

shared_open_space_per_resident_normalize_7 = Number(shared_open_space_per_resident_normalize)  # "Shared Open Space per resident - NORMALIZED"

shared_open_space_per_resident_normalize_8 = Number(shared_open_space_per_resident_normalize_2)  # "Shared Open Space per resident - NORMALIZED"

shared_open_space_per_resident_normalize_9 = Number(shared_open_space_per_resident_normalize_2)  # "Shared Open Space per resident - NORMALIZED"

shared_open_space_per_resident_normalize_10 = Number(shared_open_space_per_resident_normalize_2)  # "Shared Open Space per resident - NORMALIZED"

shared_open_space_per_resident_normalize_11 = Number(shared_open_space_per_resident_normalize_2)  # "Shared Open Space per resident - NORMALIZED"

# ----
# Distance to Urban Services
buildigns_plan_4 = Rectangle(buildigns_plan)
explode = Explode(Curve=buildigns_plan_4, Recursive=True)  # -> Segments, Vertices
item = ListItem(List=explode.Segments, Index=0, Wrap=True)
eval = EvaluateCurve(Curve=reparameterize(item), Parameter="0.5")  # -> simplify(Point), Tangent, Angle
building_entrances = Point(eval.Point)
urban_services_3 = Point(urban_services)
dist = Distance(PointA=building_entrances, PointB=urban_services_3)
distances_to_urban_services = Number(dist)
avr = Average(Input=flatten(distances_to_urban_services))
average_distances_to_urban_services = Number(avr)

# ----
# Average Distance to Links
average_distances_to_urban_services_2 = Number(average_distances_to_urban_services)

# ----
# Avg. Distance to Urban Links (0 - 500 m.)
average_distances_to_urban_services_3 = Number(average_distances_to_urban_services)
remap_7 = RemapNumbers(Value=average_distances_to_urban_services_3, Source=dom_7, Target=Domain(0, 1))  # -> Mapped, Clipped
avg_distance_to_urban_links_normalized = Number(remap_7.Clipped)

avg_distance_to_urban_links_normalized_2 = Number(avg_distance_to_urban_links_normalized)
multiplication_15 = Multiplication(A=avg_distance_to_urban_links_normalized_2, B=links_weighting_f)
urban_links_weighted = Number(multiplication_15)

urban_links_weighted_2 = Number(urban_links_weighted)
urban_links_weighted_3 = Number(urban_links_weighted)

urban_links_quality = Number(urban_links_weighted_3)
concat_13 = Concatenate(FragmentA=txt_8, FragmentB=",", FragmentC=urban_links_quality, FragmentD=",", FragmentE=number_of_surrounding_links_2)  # -> flatten(Result)
distance_to_urban_links_text = Text(concat_13)

# ----
# Shared Open Spaces
shared_open_spaces_3 = Brep(shared_open_spaces)
preview_2 = CustomPreview(Geometry=shared_open_spaces_3, Material=ColourSwatch(SwatchColor=RGBA(183, 218, 59, 166)))

shared_open_space_per_resident_normalize_12 = Number(shared_open_space_per_resident_normalize_2)  # "Shared Open Space per resident - NORMALIZED"

shared_open_space_per_resident_normalize_13 = Number(shared_open_space_per_resident_normalize_2)  # "Shared Open Space per resident - NORMALIZED"

# ----
# Minimise
avg_distance_to_urban_links_normalized_3 = Number(avg_distance_to_urban_links_normalized)

# ----
# Minimise
urban_links_weighted_4 = Number(urban_links_weighted)

# ----
# Minimise
avg_distance_to_urban_links_normalized_4 = Number(avg_distance_to_urban_links_normalized)

multiplication_16 = Multiplication(A=avg_distance_to_urban_links_normalized_4, B="10")

# ----
# Minimise
urban_links_weighted_5 = Number(urban_links_weighted)

# ----
# Minimise
avg_distance_to_urban_links_normalized_5 = Number(avg_distance_to_urban_links_normalized)

# ----
# Minimise
avg_distance_to_urban_links_normalized_6 = Number(avg_distance_to_urban_links_normalized)

# ----
# Minimise
avg_distance_to_urban_links_normalized_7 = Number(avg_distance_to_urban_links_normalized)

# ----
# Minimise
avg_distance_to_urban_links_normalized_8 = Number(avg_distance_to_urban_links_normalized)

neg_25 = Negative(Value=shared_open_space_per_resident_normalize_5)
panel_36 = Panel(shared_open_space_per_resident_normalize_5)
panel_37 = Panel(urban_links_weighted_4)

# ----
# Minimise
avg_distance_to_urban_links_normalized_9 = Number(avg_distance_to_urban_links_normalized)

panel_38 = Panel(urban_links_weighted_5)
panel_39 = Panel(shared_open_space_per_resident_normalize_8)

panel_40 = Panel(multiplication_16)
neg_26 = Negative(Value=shared_open_space_per_resident_normalize_13)
panel_41 = Panel(avg_distance_to_urban_links_normalized_4)

panel_42 = Panel(multiplication_14)
neg_27 = Negative(Value=multiplication_14)
panel_43 = Panel(shared_open_space_per_resident_normalize_6)
panel_44 = Panel(avg_distance_to_urban_links_normalized_8)

panel_45 = Panel(shared_open_space_per_resident_normalize_7)
neg_28 = Negative(Value=shared_open_space_per_resident_normalize_7)
panel_46 = Panel(avg_distance_to_urban_links_normalized_9)

neg_29 = Negative(Value=shared_open_space_per_resident_normalize_12)
panel_47 = Panel(avg_distance_to_urban_links_normalized_5)

neg_30 = Negative(Value=shared_open_space_per_resident_normalize_10)
panel_48 = Panel(shared_open_space_per_resident_normalize_10)
addition_7 = Addition(A=neg_7, B=neg_8, C=neg_9, D=neg_30)
quality_q3_for_algorithm = Number(addition_7)

neg_31 = Negative(Value=shared_open_space_per_resident_normalize_9)
panel_49 = Panel(shared_open_space_per_resident_normalize_9)
panel_50 = Panel(avg_distance_to_urban_links_normalized_7)

panel_51 = Panel(shared_open_space_per_resident_normalize_11)
neg_32 = Negative(Value=shared_open_space_per_resident_normalize_11)
panel_52 = Panel(avg_distance_to_urban_links_normalized_6)

# ----
# Shared Indoor Spaces
shared_indoor_area_per_resident_3 = Number(shared_indoor_area_per_resident)
population_7 = Number(population)
area_per_resident_5 = Number(area_per_resident)
multiplication_17 = Multiplication(A=shared_indoor_area_per_resident_3, B=population_7)
division_11 = Division(A=multiplication_17, B=area_per_resident_5)

# ----
# Private outdoor space
panel_53 = Panel("1")
pi = Pi(Factor="-1")
Z_4 = UnitZ(Factor=1)
pi_2 = Pi(Factor="-0.5")
balconies_depth = Number(max_balconies_depth)
balconies_area_4 = Number(balconies_area)
balconies_depth_2 = Number(max_balconies_depth)
division_12 = Division(A=balconies_area_4, B=balconies_depth)
balconies_width = Number(division_12)

buildigns_plan_5 = Rectangle(buildigns_plan)
units_floor_2 = Number(units_per_floor)
range = Range(Domain=Domain(0, 1), Steps=units_floor_2)
paramsrfgrid = ParameterSurfaceGrid(Surface=simplify(graft(buildigns_plan_5)), ParametersU=range, ParametersV=merge)  # -> simplify(Cells), Points
units_corridor_plan_gf = Rectangle(paramsrfgrid.Cells)
item_2 = ListItem(List=units_corridor_plan_gf, Index="1", Wrap=True)
crossref = CrossReference(ListA=graft(item_2), ListB=Z, CrossMode=1)  # -> ListA, ListB
move = Move(Geometry=crossref.ListA, Motion=crossref.ListB)  # -> simplify(Geometry), Transform
corridor_plan = Rectangle(move.Geometry)
corridors_plan = Surface(corridor_plan)

# ----
# Optimisation
corridor_plan_2 = Rectangle(corridor_plan)
item_3 = ListItem(List=units_corridor_plan_gf, Index="0", Wrap=True)
item_4 = ListItem(List=units_corridor_plan_gf, Index="2", Wrap=True)
merge_3 = Merge(Data1=item_3, Data2=item_4)

crossref_2 = CrossReference(ListA=graft(merge_3), ListB=Z, CrossMode=1)  # -> ListA, ListB
move_2 = Move(Geometry=crossref_2.ListA, Motion=crossref_2.ListB)  # -> simplify(Geometry), Transform
units_plan = Rectangle(move_2.Geometry)
extr = Extrude(Base=units_plan, Direction=Z_2)
units = Box(extr)

units_plan_2 = Rectangle(units_plan)

units_corridor_plan = Rectangle(units_plan)
c_script = CSharpScript(x=units_corridor_plan)  # -> out, A; inputs x: tree of Rectangle3d
# ---------- c_script: C# ----------
    DataTree<Rectangle3d> r = new DataTree<Rectangle3d>();
    GH_Path g;

    if(x.Path(0).Length == 2)
    {

      for(int b = 0; b < x.BranchCount; b++)
      {
        for(int i = 0; i < x.Branch(b).Count; i++)
        {
          g = new GH_Path(x.Path(b)[0], i);
          r.Add(x.Branch(b)[i], g);
        }
      }
    }
  else
    {
      Print("tres");
      for(int b = 0; b < x.BranchCount; b++)
      {
        for(int i = 0; i < x.Branch(b).Count; i++)
        {
          g = new GH_Path(x.Path(b)[0], x.Path(b)[1], i);
          r.Add(x.Branch(b)[i], g);
        }
      }
    }
    A = r;
# ---------- end c_script ----------
units_corridor_plan_u = Rectangle(c_script.A)
item_5 = ListItem(List=units_corridor_plan_u, Index=panel_53, Wrap=True)
item_6 = ListItem(List=units_corridor_plan_u, Index=0, Wrap=True)
area_6 = Area(Geometry=item_5)  # -> Area, Centroid
pl_3 = ConstructPlane(Origin=area_6.Centroid, XAxis=Vector(1, 0, 0), YAxis=Vector(0, 1, 0))
rotate = Rotate(Geometry=item_5, Angle=pi, Plane=pl_3)  # -> Geometry, Transform
merge_4 = Merge(Data1=item_6, Data2=rotate.Geometry)
units_plan_3 = Rectangle(merge_4)
explode_2 = Explode(Curve=units_plan_3, Recursive=True)  # -> Segments, Vertices
item_7 = ListItem(List=explode_2.Segments, Index=0, Wrap=True)
eval_2 = EvaluateCurve(Curve=item_7, Parameter="0")  # -> Point, Tangent, Angle
vrot = Rotate(Vector=eval_2.Tangent, Axis=Z_4, Angle=pi_2)
amp = Amplitude(Vector=vrot, Amplitude=balconies_depth_2)
balconies_extrusion_vector = Vector(amp)
line = LineSDL(Start=eval_2.Point, Direction=eval_2.Tangent, Length=balconies_width)
extr_2 = Extrude(Base=line, Direction=balconies_extrusion_vector)
balconies = Surface(extr_2)
wires = BrepWireframe(Brep=balconies, Density=-1)

balconies_2 = Surface(balconies)
area_7 = Area(Geometry=balconies_2)  # -> Area, Centroid
balconies_curve = Rectangle(balconies)
merge_5 = Merge(Data1=plot_2, Data2=balconies_curve, Data3=units_plan_2, Data4=corridor_plan_2)  # -> flatten(Result)
panel_54 = Panel(units_corridor_plan)

units_2 = Box(units)
reduce = RandomReduce(List=flatten(units_2), Reduction=division_11, Seed=division_11)
box_2 = Box(reduce)

srf_2 = Surface(units_plan)

# ----
# Private outdoor space
swatch = ColourSwatch(SwatchColor=RGB(105, 147, 71))
balconies_3 = Surface(balconies)
preview_3 = CustomPreview(Geometry=balconies_3, Material=swatch)

units_plan_4 = Rectangle(units_plan)
area_8 = Area(Geometry=units_plan_4)  # -> Area, Centroid

merge_6 = Merge(Data1=area_8.Area, Data2=area_7.Area)  # -> flatten(Result)

ma = MassAddition(Input=flatten(merge_6))  # -> Result, PartialResults
multiplication_18 = Multiplication(A=ma.Result, B=cost_sqm_2)
addition_8 = Addition(A=multiplication_18, B=multiplication_5)
cost = Number(addition_8)

# ----
# Minimise
cost_2 = Number(cost)

division_13 = Division(A=cost_2, B=population_2)

remap_8 = RemapNumbers(Value=division_13, Source=dom_8, Target=Domain(0, 1))  # -> Mapped, Clipped
cost_normalized = Number(remap_8.Clipped)

# ----
# Minimise
cost_normalized_2 = Number(cost_normalized)
multiplication_19 = Multiplication(A=cost_normalized_2, B=cost_sqm_weighting_f_2)
cost_sqm_weighted = Number(multiplication_19)

cost_sqm_weighted_2 = Number(cost_sqm_weighted)
cost_sqm_weighted_3 = Number(cost_sqm_weighted)

cost_sqm_quality = Number(cost_sqm_weighted_3)
concat_14 = Concatenate(FragmentA=txt_9, FragmentB=",", FragmentC=cost_sqm_quality, FragmentD=",", FragmentE=cost_sqm_3)  # -> flatten(Result)
shared_open_space_text_2 = Text(concat_14)

cost_sqm_weighted_4 = Number(cost_sqm_weighted)

cost_sqm_weighted_5 = Number(cost_sqm_weighted)

cost_normalized_3 = Number(cost_normalized)

cost_normalized_4 = Number(cost_normalized)

cost_normalized_5 = Number(cost_normalized)

cost_normalized_6 = Number(cost_normalized)

cost_normalized_7 = Number(cost_normalized)

cost_normalized_8 = Number(cost_normalized)

panel_55 = Panel(cost_sqm_weighted_4)
addition_9 = Addition(A=neg_4, B=neg_5, C=neg_6, D=neg_25, E=cost_sqm_weighted_4, F=urban_links_weighted_4)
addition_10 = Addition(
    A=area_per_resident_weighted_4,
    B=private_outdoor_space_weighted_4,
    C=density_units_ha_normalized_6,
    D=shared_open_space_per_resident_normalize_5,
    E=cost_sqm_weighted_4,
    F=urban_links_weighted_4)
quality_q = Number(addition_9)
panel_56 = Panel(quality_q)
quality_q_2 = Number(addition_10)
quality_q_for_algorithm = Number(addition_9)
panel_57 = Panel(quality_q_2)

panel_58 = Panel(cost_sqm_weighted_5)
addition_11 = Addition(
    A=area_per_resident_weighted_5,
    B=private_outdoor_space_weighted_5,
    C=density_units_ha_normalized_12,
    D=shared_open_space_per_resident_normalize_8,
    E=cost_sqm_weighted_5,
    F=urban_links_weighted_5)
quality_q_3 = Number(addition_11)
panel_59 = Panel(quality_q_3)

cost_normalized_9 = Number(cost_normalized)

multiplication_20 = Multiplication(A=cost_normalized_3, B="10")

panel_60 = Panel(multiplication_20)
panel_61 = Panel(cost_normalized_3)
addition_12 = Addition(
    A=area_per_resident_normalized_5,
    B=private_outdoor_space_normalized_5,
    C=density_units_ha_normalized_8,
    D=shared_open_space_per_resident_normalize_12,
    E=cost_normalized_3,
    F=avg_distance_to_urban_links_normalized_5)
addition_13 = Addition(A=neg_21, B=neg_20, C=neg_19, D=neg_29, E=multiplication_20, F=avg_distance_to_urban_links_normalized_5)
quality_q6 = Number(addition_12)
panel_62 = Panel(quality_q6)
quality_q6_for_algorithm = Number(addition_13)

quality_q_4 = Number(quality_q_2)

concat_15 = Concatenate(FragmentA=txt_11, FragmentD=txt_13, FragmentB="=", FragmentC=quality_q_4)
merge_7 = Merge(
    Data1=concat_15,
    Data2=txt_14,
    Data3=concat,
    Data4=area_per_resident_text,
    Data5=private_outdoor_space_text,
    Data6=density_text,
    Data7=shared_open_space_text,
    Data8=shared_open_space_text_2,
    Data9=distance_to_urban_links_text,
    Data10=number_of_buildings_text,
    Data11=number_of_floors_text,
    Data12=txt_14,
    Data13="QUALITY VALUES EXPLANATION",
    Data14=q_explanation_3)  # -> flatten(Result)
write_text = Text(merge_7)
writetxt = WriteToTextFile(Run=Toggle(False), TextToWrite=write_text, FilePath=concat_10, Append=False, NewOnly=False)

panel_63 = Panel(cost_normalized_4)
addition_14 = Addition(
    A=area_per_resident_normalized_6,
    B=private_outdoor_space_normalized_6,
    C=density_units_ha_normalized_9,
    D=shared_open_space_per_resident_normalize_13,
    E=cost_normalized_4,
    F=avg_distance_to_urban_links_normalized_4)
addition_15 = Addition(A=neg_24, B=neg_23, C=neg_22, D=neg_26, E=cost_normalized_4, F=multiplication_16)
quality_q7 = Number(addition_14)
panel_64 = Panel(quality_q7)
quality_q7_for_algorithm = Number(addition_15)

panel_65 = Panel(cost_normalized_8)
addition_16 = Addition(
    A=area_per_resident_normalized_8,
    B=private_outdoor_space_normalized_8,
    C=density_units_ha_normalized_11,
    D=shared_open_space_per_resident_normalize_9,
    E=cost_normalized_8,
    F=avg_distance_to_urban_links_normalized_7)
addition_17 = Addition(A=neg_10, B=neg_12, C=neg_11, D=neg_31, E=cost_normalized_8, F=avg_distance_to_urban_links_normalized_7)
quality_q5 = Number(addition_16)
panel_66 = Panel(quality_q5)
quality_q5_for_algorithm = Number(addition_17)

panel_67 = Panel(cost_normalized_7)
addition_18 = Addition(
    A=area_per_resident_normalized_7,
    B=private_outdoor_space_normalized_7,
    C=density_units_ha_normalized_10,
    D=shared_open_space_per_resident_normalize_6,
    E=cost_normalized_7,
    F=avg_distance_to_urban_links_normalized_8)
addition_19 = Addition(A=neg_13, B=neg_15, C=neg_14, D=neg_27, E=cost_normalized_7, F=avg_distance_to_urban_links_normalized_8)
quality_q4 = Number(addition_18)
panel_68 = Panel(quality_q4)
quality_q4_for_algorithm = Number(addition_19)

addition_20 = Addition(
    A=area_per_resident_normalized_4,
    B=private_outdoor_space_normalized_4,
    C=density_units_ha_normalized_7,
    D=shared_open_space_per_resident_normalize_7,
    E=cost_normalized_9,
    F=avg_distance_to_urban_links_normalized_9)
panel_69 = Panel(cost_normalized_9)
addition_21 = Addition(A=neg_16, B=neg_17, C=neg_18, D=neg_28, E=cost_normalized_9, F=avg_distance_to_urban_links_normalized_9)
quality_q1 = Number(addition_20)
panel_70 = Panel(quality_q1)
quality_q1_2 = Number(addition_21)

panel_71 = Panel(cost_normalized_6)
addition_22 = Addition(
    A=area_per_resident_normalized_9,
    B=private_outdoor_space_normalized_9,
    C=density_units_ha_normalized_13,
    D=shared_open_space_per_resident_normalize_11,
    E=cost_normalized_6,
    F=avg_distance_to_urban_links_normalized_6)
addition_23 = Addition(A=neg_3, B=neg_2, C=neg, D=neg_32, E=cost_normalized_6, F=avg_distance_to_urban_links_normalized_6)
quality_q2 = Number(addition_22)
panel_72 = Panel(quality_q2)
quality_q2_2 = Number(addition_23)
panel_73 = Panel(quality_q2_2)

addition_24 = Addition(
    A=area_per_resident_normalized_3,
    B=private_outdoor_space_normalized_3,
    C=density_units_ha_normalized_5,
    D=shared_open_space_per_resident_normalize_10,
    E=cost_normalized_5,
    F=avg_distance_to_urban_links_normalized_3)
quality_q3 = Number(addition_24)
panel_74 = Panel(quality_q3)

panel_75 = Panel(write_text)
quality_q5_2 = Number(quality_q5)
quality_q6_2 = Number(quality_q6)
quality_q4_2 = Number(quality_q4)
quality_q2_3 = Number(quality_q2)
quality_q1_3 = Number(quality_q1)
quality_q7_2 = Number(quality_q7)
quality_q_5 = Number(quality_q_2)
panel_76 = Panel(quality_q_5)

quality_q_6 = Number(quality_q_2)
concat_16 = Concatenate(FragmentA="Q'_", FragmentB=quality_q_5)
q_layer_name = Text(concat_16)

wallacei_x = WallaceiX(
    Genes=[wlc_area_per_resident, number_slider_3, density, wlc_plot_area, number_slider_4, links, number_slider_6, number_slider_5],
    Objectives=[neg_4, neg_5, neg_6, neg_25, cost_sqm_weighted_4, urban_links_weighted_4],
    Data=[area_per_resident_weighted_4, private_outdoor_space_weighted_4, density_units_ha_normalized_6, shared_open_space_per_resident_normalize_5, cost_sqm_weighted_4, urban_links_weighted_4, neg_5],
    Phenotype=merge_5,
    allFitness="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",
    allFrontIdx="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",
    allGenomes="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",
    curFrontIdx="99|0;99|1;99|2;99|3;99|4;99|5;99|6;99|7;99|8;99|9;99|10;99|11;99|12;99|13;99|14;99|15;99|16;99|17;99|18;99|19;99|20;99|21;99|22;99|23;99|24;99|25;99|26;99|27;99|28;99|29;99|30;99|31;99|32;99|33;99|34;99|35;99|36;99|37;99|38;99|39;99|40;99|41;99|42;99|43;99|44;99|45;99|46;99|47;99|48;99|49",
    curFrontIdxSave="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",
    popGen="50,100",
    total="1927172",
    wlcDone=True)  # -> WallaceiGenomes, FitnessValues, Data, WPhenotypes

q_layer_name_2 = Text(q_layer_name)
corridors_plan_2 = Surface(corridors_plan)
balconies_4 = Surface(balconies)
units_3 = Box(units)
concat_17 = Concatenate(FragmentA=q_layer_name_2, FragmentB="Plot")
concat_18 = Concatenate(FragmentA=q_layer_name_2, FragmentB="Balconies")
concat_19 = Concatenate(FragmentA=q_layer_name_2, FragmentB="Urban Services")
concat_20 = Concatenate(FragmentA=q_layer_name_2, FragmentB="Corridors Plan")
concat_21 = Concatenate(FragmentA=q_layer_name_2, FragmentB="Units")
concat_22 = Concatenate(FragmentA=q_layer_name_2, FragmentB="Links to Urban Services")
bake = ObjectBake(
    BakeToggle=toggle,
    GeometryObjects=srf,
    Layer=concat_17,
    ObjectName="GH_Obj",
    ObjectColor=RGB(255, 255, 255),
    LayerColor=RGB(255, 255, 255))
bake_2 = ObjectBake(
    BakeToggle=toggle,
    GeometryObjects=balconies_4,
    Layer=concat_18,
    ObjectName="GH_Obj",
    ObjectColor=RGB(255, 255, 255),
    LayerColor=RGB(255, 255, 255))
bake_3 = ObjectBake(
    BakeToggle=toggle,
    GeometryObjects=flatten(corridors_plan_2),
    Layer=concat_20,
    ObjectName="GH_Obj",
    ObjectColor=RGB(255, 255, 255),
    LayerColor=RGB(255, 255, 255))
bake_4 = ObjectBake(
    BakeToggle=toggle,
    GeometryObjects=flatten(units_3),
    Layer=concat_21,
    ObjectName="GH_Obj",
    ObjectColor=RGB(255, 255, 255),
    LayerColor=RGB(255, 255, 255))
bake_5 = ObjectBake(
    BakeToggle=toggle,
    GeometryObjects=urban_services_2,
    Layer=concat_19,
    ObjectName="GH_Obj",
    ObjectColor=RGB(255, 255, 255),
    LayerColor=RGB(255, 255, 255))

# ----
# Distances to Urban Services
building_entrances_2 = Point(building_entrances)
urban_services_4 = Point(urban_services)
ln_2 = Line(StartPoint=building_entrances_2, EndPoint=urban_services_4)
dash_2 = DashPattern(Curve=ln_2, Pattern="2")  # -> Dashes, Gaps

line_links_to_urban_services = Line(dash_2.Dashes)

line_links_to_urban_services_2 = Line(line_links_to_urban_services)
bake_6 = ObjectBake(
    BakeToggle=toggle,
    GeometryObjects=flatten(line_links_to_urban_services_2),
    Layer=concat_22,
    ObjectName="GH_Obj",
    ObjectColor=RGB(255, 255, 255),
    LayerColor=RGB(255, 255, 255))

preview_4 = CustomPreview(Geometry=line_links_to_urban_services, Material=ColourSwatch(SwatchColor=RGB(219, 152, 255)))
